# Grasshopper definition populatingGeometryOverArea.gh (Grasshopper 1.0.8)

_3d_populatingfield = GetGeometry(AnnotationTypeFilter=3966, AtLeast=1, AtMost=1, DeleteInput=False, Filter=1074081855, TreeAccess=False)
geometryoriginplane = GetPlane(AtLeast=1, AtMost=1, Realtime=True, TreeAccess=False)
seeds = GetInteger(AtLeast=1, AtMost=1, Maximum=2147483647, Minimum=-2147483648, TreeAccess=False)
count = GetInteger(AtLeast=1, AtMost=1, Maximum=2147483647, Minimum=-2147483648, TreeAccess=False)
geometry = GetGeometry(AnnotationTypeFilter=3966, AtLeast=1, AtMost=1, DeleteInput=False, Filter=1074081855, TreeAccess=False)
populate_3d = Populate3D(Region=_3d_populatingfield, Count=count, Seed=seeds)
orient = Orient(Geometry=geometry, Source=geometryoriginplane, Target=populate_3d)  # -> Geometry, Transform
list_length = ListLength(List=orient.Geometry)
context_bake = ContextBake(Populated_Geometry=orient.Geometry)
context_bake_2 = ContextBake(Transform=orient.Transform)
context_print = ContextPrint(Count=list_length)
