# Grasshopper definition populatingSphereInsideVolume_Updated.gh (Grasshopper 1.0.8)

_3d_container = GetGeometry(
    AnnotationTypeFilter=3966,
    AtLeast=1,
    AtMost=1,
    DeleteInput=False,
    Filter=1074081855,
    Prompt="input a box or something",
    TreeAccess=False)
seeds = GetInteger(AtLeast=1, AtMost=1, Maximum=2147483647, Minimum=-2147483648, TreeAccess=False)
count = GetInteger(AtLeast=1, AtMost=1, Maximum=2147483647, Minimum=-2147483648, TreeAccess=False)
sphere = GetGeometry(AnnotationTypeFilter=3966, AtLeast=1, AtMost=1, DeleteInput=False, Filter=1074081855, TreeAccess=False)
originpoint = GetPlane(AtLeast=1, AtMost=1, Realtime=True, TreeAccess=False)
populate_3d = Populate3D(Region=_3d_container, Count=count, Seed=seeds)
orient = Orient(Geometry=sphere, Source=originpoint, Target=populate_3d)  # -> Geometry, Transform
list_length = ListLength(List=orient.Geometry)
context_bake = ContextBake(Populated_Geometry=orient.Geometry)
context_bake_2 = ContextBake(Transform=orient.Transform)
context_print = ContextPrint(Count=list_length)
