# Grasshopper definition runSample.gh (Grasshopper 1.0.8)
# plug-ins: Hops

number_slider = Slider(29, range=0..100)
sphere = Sphere(Base=PlaneXY(0, 0, 0), Radius=1)
domain_box = DomainBox(Base=PlaneXY(0, 0, 0), X=number_slider, Y=number_slider, Z=number_slider)
volume = Volume(Geometry=sphere)  # -> Volume, Centroid
hops = Hops(
    Geometry=sphere,
    GeometryOriginPlane=volume.Centroid,
    _3D_PopulatingField=domain_box,
    Count=Slider(20, range=0..100),
    Seeds=Slider(4, range=0..10),
    CacheResultsInMemory=True,
    CacheSolveResults=True,
    RemoteDefinitionLocation="D:\IAAC\Master\BIMSC\S3. Cloud based Data Management\Session_01\Repo\bimsc25-datamgmt-session01\populatingGeometryOverArea.gh",
    RemoteSolveVersion=(0, 1, 0),
    ShowInput_Enabled=False,
    ShowInput_Path=False,
    SynchronousSolve=True)  # -> Populated_Geometry, Transform, Count
